# Grasshopper definition inhabitants.gh (Grasshopper 1.0.7)
# plug-ins: Kangaroo2 Components

pt = ConstructPoint(XCoordinate=Slider(0, range=0..100), YCoordinate=Slider(0, range=0..100), ZCoordinate=Slider(200, range=0..100000))
X = UnitX(Factor=1)
Y = UnitY(Factor=1)
pl = ConstructPlane(Origin=pt, XAxis=X, YAxis=Y)
mbox = MeshBox(Base=pl, XCount=10, YCount=10, ZCount=10)

mesh = Mesh(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)
number_slider = Slider(10.4, range=0..200)
Z = UnitZ(Factor=1)
popgeo = PopulateGeometry(Geometry=mbox, Count=Slider(20, range=0..1000), Seed=1)
multiplication = Multiplication(A=Z, B="-1")
# Press button
button = Button()
show = Show(G=popgeo)
sc = SphereCollide(Points=popgeo, Radius=number_slider, Strength=1)
load = Load(Point=popgeo, ForceVector=multiplication, Weighting=1)
spc = SolidPointCollide(Points=popgeo, Solid=mesh, Interior=Slider(1, range=0..1), Unidirectional=True, Strength=1)
bouncysolver = BouncySolver(GoalObjects=[load, show, sc, spc], Reset=button, Threshold=1e-15, Tolerance=0.01, Damping=0.99, Iterations=10, On=True)  # -> I, V, O
Z_2 = UnitZ(Factor=number_slider)
pt_2 = Point(bouncysolver.O)
move = Move(Geometry=pt_2, Motion=Z_2)  # -> Geometry, Transform
msphere = MeshSphere(Base=move.Geometry, Radius=number_slider, UCount=10, VCount=20)
preview = CustomPreview(
    Geometry=msphere,
    Material={diffuse=RGB(221, 160, 221), emission=RGB(66, 48, 66), shine=0.5, specular=RGB(255, 255, 255), transparency=0})
