# Grasshopper definition mushroom.gh (Grasshopper 1.0.7)

timer = Timer(TimerInterval=1, Target=c_script)  # disabled
number_slider = Slider(3, range=0..100)
colour_rgb = ColourRGB(Alpha=255, Red="130", Green=0, Blue=0)
mesh = Mesh(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)
c_script = CSharpScript(reset=Button())  # -> out, framerate; inputs reset: Boolean
# ---------- c_script: C# usings ----------
using System.IO;
using System.Linq;
using System.Data;
using System.Drawing;
using System.Reflection;
using System.Windows.Forms;
using System.Xml;
using System.Xml.Linq;
using System.Runtime.InteropServices;

using Rhino.DocObjects;
using Rhino.Collections;
using GH_IO;
using GH_IO.Serialization;
# ---------- c_script: C# ----------
    num = reset ? 0 : num + 1;
    framerate = num;
    Print(num.ToString());
# ---------- c_script: C# additional code ----------
  private int num = 0;
# ---------- end c_script ----------
panel = Panel(c_script.framerate)
# (GHsharp) Find mesh face
# centers and normals
custom_preview = CustomPreview(Geometry=mesh, Material=colour_rgb)
c_script_2 = CSharpScript(M=mesh, pt="{0,0,-10}")  # -> out, C, N; inputs M: Mesh, pt: Point3d
# ---------- c_script_2: C# ----------
    // reference: GHsharp

    // Create an array with all face centers.
    Point3d[] centers = new Point3d[M.Faces.Count];
    for (int i = 0; i < M.Faces.Count; i++) {
      Point3d center = M.Faces.GetFaceCenter(i);
      centers[i] = center;
    }

    // Meshes may not contain face normal information.
    // If it isn't available, compute it.
    if (M.FaceNormals.Count != M.Faces.Count) {
      M.FaceNormals.ComputeFaceNormals();
    }
    C = centers;
    N = M.FaceNormals;
    // Outputs
# ---------- end c_script_2 ----------
number_slider_2 = Slider(13, range=0..100)
number_slider_3 = Slider(15, range=0..100)
c_script_3 = CSharpScript(x=c_script.framerate)  # -> out, A; inputs x: Double
# ---------- c_script_3: C# ----------
    A = (  (Math.Abs(Math.Sin(x / 10)) + 0.2 ) * 25);
    if (x ==10)
    {
      for (int i = 0; i < 5; i++)
      {
        A = (  (Math.Abs(Math.Sin(10 / 10)) + 0.2 ) * 25);
      }
    }
# ---------- end c_script_3 ----------
c_script_4 = CSharpScript(x=c_script.framerate)  # -> out, A; inputs x: Double
# ---------- c_script_4: C# ----------
    A = (  (Math.Abs(Math.Sin(x / 10)) ) * 25 / 50);
# ---------- end c_script_4 ----------
c_script_5 = CSharpScript(x=c_script.framerate)  # -> out, A; inputs x: Double
# ---------- c_script_5: C# ----------
    A = (  (Math.Abs(Math.Sin(x / 10)) + 0.2 ) * 25 / 6);
# ---------- end c_script_5 ----------
c_script_6 = CSharpScript(x=c_script.framerate)  # -> out, A; inputs x: Double
# ---------- c_script_6: C# ----------
    A = (  (Math.Abs(Math.Sin(x / 10)) ) * 10);
# ---------- end c_script_6 ----------
panel_2 = Panel(c_script_3.A)
panel_3 = Panel(c_script_4.A)
panel_4 = Panel(c_script_5.A)
panel_5 = Panel(c_script_6.A)
# Filter out points wanted
# for mushroom base, and
# find mushroom base by
# adding a vector related to
#  time and a random vector
c_script_7 = CSharpScript(C=c_script_2.C, x=c_script_2.N, pt="{0,0,-10}", t=panel_2)  # -> out, A, shroomBase, shroomVec, shroomTop; inputs C: list of Point3d, x: list of Vector3d, pt: Point3d, t: Double
# ---------- c_script_7: C# ----------
    Sphere s = new Sphere(pt, 25);

    List <Point3d> mptb = new List <Point3d> ();
    List <Point3d> mptt = new List <Point3d> ();
    List <Vector3d> v = new List <Vector3d> ();
    List <Vector3d> dir = new List <Vector3d> ();
    //identify base points below boundary
    for (int i = 0; i < C.Count; i++)
    {
      double dis = pt.DistanceTo(C[i]);
      if (dis < 25)
      {
        mptb.Add(C[i]);
        v.Add(x[i]);
      }
    }
    shroomBase = mptb;
    shroomVec = v;

    //Generate random numbers for vectors
    //random num for x,y directions
    List <Random> rand = new List <Random> ();
    List <double> randnum = new List <double> ();

    for(int k = 0; k < 1; k++)
    {
      for(int l = 0; l < v.Count; l++)
      {
        Random n = new Random();
        rand.Add(n);
        double zzz = rand[k].Next(-2, 2);
        randnum.Add(zzz);
      }
    }
    List <Random> rand1 = new List <Random> ();
    List <double> randnum1 = new List <double> ();

    //random num for x,y directions
    for(int k = 0; k < 1; k++)
    {
      for(int l = 0; l < v.Count; l++)
      {
        Random n = new Random();
        rand1.Add(n);
        double zzz = rand1[k].NextDouble() + 1;
        randnum1.Add(zzz);
      }
    }

    //generate vector and top points
    for(int j = 0; j < v.Count; j++)
    {
      Vector3d dirtemp = new Vector3d(randnum[j], randnum[j],randnum[j]*1.5+ t);
      dir.Add(dirtemp);
      mptt.Add(mptb[j] + dir[j]);
    }
    shroomTop = mptt;
# ---------- c_script_7: C# additional code ----------
  /// <summary>
  /// This method will be called once every solution, before any calls to RunScript.
  /// </summary>
  public override void BeforeRunScript()
  { }
  /// <summary>
  /// This method will be called once every solution, after any calls to RunScript.
  /// </summary>
  public override void AfterRunScript()
  { }
# ---------- end c_script_7 ----------
# Create mushroom body
c_script_8 = CSharpScript(a=c_script_7.shroomTop, b=c_script_7.shroomBase, c=panel_4, d=panel_5, e=panel_3, U=number_slider_2, V=number_slider_3)  # -> out, axis, A, basePt, Shroom, pts; inputs a: Point3d, b: Point3d, c: Double, d: Double, e: Double, U: Int32, V: Int32
# ---------- c_script_8: C# ----------
    //create a line from two pts

    Line base1 = new Line(a, b);
    axis = base1;
    //convert line to curve
    NurbsCurve base2 = base1.ToNurbsCurve();

    //divide to control pts
    int controlPtsNum = 50;
    Point3d [] dividedPt;
    base2.DivideByCount(controlPtsNum, true, out dividedPt);
    int divPtCount = dividedPt.Length;
    Vector3d udir = new Vector3d(base1.Direction);
    udir.Unitize();


    //alter the curve to look like a shroom
    Curve shroomCrv;

    for (int i = 0; i < divPtCount; i++)
    {
      //shroom head
      if (i < divPtCount / 3)
      {
        Vector3d v = new Vector3d(-c * Math.Sqrt(i) - udir.Z, d * udir.Y, d * udir.X);
        dividedPt[i] = dividedPt[i] + v;
      }
        //shroom body
      else if (i >= divPtCount / 3 && i < divPtCount - 1)
      {
        Vector3d v = new Vector3d(-e * Math.Sqrt(i) * -udir.Z, udir.Y, udir.X);
        dividedPt[i] = dividedPt[i] + v;
      }
    }

    shroomCrv = Curve.CreateControlPointCurve(dividedPt, 3); // create shroom curve
    A = shroomCrv;
    //revolve curve around base 1
    Line revolveAxis = new Line(shroomCrv.PointAtStart, b);
    Plane planeCir = new Plane(a, revolveAxis.Direction);
    Circle revolveCir = new Circle(planeCir, 5);
    NurbsCurve revolveCrv = revolveCir.ToNurbsCurve();

    NurbsSurface shroom = NurbsSurface.CreateRailRevolvedSurface(shroomCrv, revolveCrv, revolveAxis, false);

    //rebuild a smooth shroom
    Shroom = shroom.Rebuild(3, 3, U, V);
# ---------- end c_script_8 ----------
curve = Curve(c_script_8.axis)
point = Point(c_script_8.basePt)
curve_2 = Curve(c_script_8.A)
# remap U, V on the surface,
# find intersecting points and
# normals
surface = Surface(c_script_8.Shroom)
divide_surface = DivideSurface(Surface=c_script_8.Shroom, UCount=number_slider_2, VCount=number_slider_3)  # -> simplify(flatten(Points)), simplify(flatten(Normals)), Parameters
# creates circles from previous
# points and planes
c_script_9 = CSharpScript(origin=divide_surface.Points, normal=divide_surface.Normals, x=panel_2)  # -> out, plane, circles, O; inputs origin: list of Point3d, normal: list of Vector3d, x: Double
# ---------- c_script_9: C# ----------
    List<Plane> plane1 = new List<Plane>();

    int o = origin.Count;

    for (int i = 0; i < o; i++)
    {
      Plane P = new Plane(origin[i], normal[i]);
      plane1.Add(P);
    }
    plane = plane1;

    O = o;
    List <Circle> cir = new List<Circle>();


    for (int j = 0; j < o;j++)
    {

      Circle c = new Circle(plane1[j], x / 40);
      cir.Add(c);

    }

    circles = cir;
# ---------- end c_script_9 ----------
colour_rgb_2 = ColourRGB(Alpha="255", Red="255", Green="255", Blue="255")
curve_3 = Curve(c_script_9.circles)
custom_preview_2 = CustomPreview(Geometry=surface, Material=colour_rgb_2)

txt = Text(curve_3)
chars = Characters(Text=txt)  # -> Result, Unicode
# filter out invalid curves
item = ListItem(List=chars.Result, Index=0, Wrap=True)  # -> flatten(Item)
tmatch = MatchText(Text=item, Pattern="C", Case=True)
dispatch = Dispatch(List=curve_3, DispatchPattern=tmatch)  # -> ListA, ListB

colour_rgb_3 = ColourRGB(Alpha=255, Red="255", Green=0, Blue=0)
# create mesh dots
c_script_10 = CSharpScript(x=dispatch.ListA)  # -> out, A; inputs x: list, y: Plane
# ---------- c_script_10: C# ----------
  
    List<Mesh> dot = new List<Mesh>();
    for (int i = 0;i < x.Count;i++)
    {
      //Print(x);
      Polyline dot_poly = Polyline.CreateInscribedPolygon(x[i], 12);
      Mesh dot_mesh = Mesh.CreateFromClosedPolyline(dot_poly);
      dot.Add(dot_mesh);
    }
    A = dot;
# ---------- end c_script_10 ----------
custom_preview_3 = CustomPreview(Geometry=c_script_10.A, Material=colour_rgb_3)
