# Grasshopper definition pumpkin1026.gh (Grasshopper 1.0.7)
# plug-ins: LunchBox

timer = Timer(TimerInterval=20, Target=c_script)  # disabled
c_script = CSharpScript(reset=Button())  # -> out, framerate; inputs reset: Boolean
# ---------- c_script: C# usings ----------
using System.IO;
using System.Linq;
using System.Data;
using System.Drawing;
using System.Reflection;
using System.Windows.Forms;
using System.Xml;
using System.Xml.Linq;
using System.Runtime.InteropServices;

using Rhino.DocObjects;
using Rhino.Collections;
using GH_IO;
using GH_IO.Serialization;
# ---------- c_script: C# ----------
    num = reset ? 0 : num + 1;
    framerate = num;
    Print(num.ToString());
# ---------- c_script: C# additional code ----------
  private int num = 0;
# ---------- end c_script ----------

c_script_2 = CSharpScript(x=c_script.framerate)  # -> out, A; inputs x: Double
# ---------- c_script_2: C# ----------
    A = ( 70 * Math.Abs(Math.Sin(x / 10)) * 3) + 50;
# ---------- end c_script_2 ----------
c_script_3 = CSharpScript(x=c_script.framerate)  # -> out, A; inputs x: Double
# ---------- c_script_3: C# ----------
    A = ( Math.Abs(Math.Sin(x / 10)) * 3) + 0.5;
# ---------- end c_script_3 ----------
c_script_4 = CSharpScript(x=c_script.framerate)  # -> out, A; inputs x: Double
# ---------- c_script_4: C# ----------
    A = (x % 10) * 0.5;
# ---------- end c_script_4 ----------
round = Round(Number=c_script_2.A)  # -> Nearest, Floor, Ceiling

pt = Point(Point(0, 0, 0))

c_script_5 = CSharpScript(org=pt, pumCol="8", height=round.Floor, ratio=c_script_3.A, x=c_script_4.A)  # -> out, D, C, E, F; inputs org: Point3d, pumCol: Int32, height: Double, ratio: Double, x: Double, angle: Double
# ---------- c_script_5: C# ----------
    //pumpkin surf
    double width = height / ratio;
    double radius = 2 * Math.PI / pumCol;
    List<List<Point3d>> ctrList = new List<List<Point3d>> ();
    List<Curve> edge_in = new List<Curve>();
    List<Curve> edge_out = new List<Curve>();
    List<Curve> edge_mid = new List<Curve>();
    Vector3d z = new Vector3d(0, 0, 1);
    Vector3d y = new Vector3d(0, 1, 0);


    List<double> widthList = new List<double>();
    widthList.Add(1.6);
    widthList.Add(1.7);
    widthList.Add(1.5);
    widthList.Add(1);
    widthList.Add(0.9);
    widthList.Add(0.6);

    //bottom
    List<Point3d > ctrPt_bt = new List<Point3d>();
    for (int i = 0; i < pumCol;i++)
    {

      Point3d Pt = org;
      Vector3d vec = new Vector3d(width * 0.4, 0, 0);
      vec.Rotate(i * radius, z);
      Pt.Transform(Rhino.Geometry.Transform.Translation(vec));
      ctrPt_bt.Add(Pt);
    }
    ctrList.Add(ctrPt_bt);

    //body
    for( int j = 0 ; j < widthList.Count; j++)
    {
      Vector3d up = new Vector3d(0, 0, j * height / 5);
      Point3d orgPt = org;
      orgPt.Transform(Rhino.Geometry.Transform.Translation(up));
      List<Point3d> ctrPt = new List<Point3d> ();
      ctrList.Add(ctrPt);

      for (int i = 0; i < pumCol;i++)
      {
        Point3d Pt = orgPt;
        Vector3d vec = new Vector3d(widthList[j] * width, 0, 0);
        vec.Rotate(i * radius, z);
        Pt.Transform(Rhino.Geometry.Transform.Translation(vec));
        ctrPt.Add(Pt);
      }
    }

    //Top
    List<Point3d > ctrPt_tp = new List<Point3d>();
    for (int i = 0; i < pumCol;i++)
    {
      Vector3d up = new Vector3d(0, 0, height);
      Point3d orgPt = org;
      orgPt.Transform(Rhino.Geometry.Transform.Translation(up));
      Point3d Pt = orgPt;
      Vector3d vec = new Vector3d(width * 0.4, 0, 0);
      vec.Rotate(i * radius, z);
      Pt.Transform(Rhino.Geometry.Transform.Translation(vec));
      ctrPt_tp.Add(Pt);
    }
    ctrList.Add(ctrPt_tp);

    // edge inner
    for (int i = 0; i < pumCol;i++)
    {
      List < Point3d > edgePt = new List<Point3d>();
      for(int j = 0; j < widthList.Count + 2; j++)
      {
        Point3d pt = ctrList[j][i];
        edgePt.Add(pt);
      }

      Curve c = Curve.CreateControlPointCurve(edgePt, 3);
      edge_in.Add(c);
    }
    edge_in.Add(edge_in[0]);

    // edge outer
    for (int i = 0; i < pumCol;i++)
    {
      Curve c = edge_in[0].DuplicateCurve();
      Plane pl = new Plane(org, z);
      c.Transform(Rhino.Geometry.Transform.Scale(pl, 1.2, 1, 1));
      c.Rotate((i + 0.5) * radius, z, org);
      edge_out.Add(c);
    }

    // edge mid + dot
    List<Mesh> dot = new List<Mesh>();
    List<Sphere> Dot = new List<Sphere>();
    for (int i = 0; i < pumCol;i++)
    {
      Plane pl = new Plane(org, z);
      double out_in_scale = 1.2;

      Plane mirror = new Plane (org, y);
      mirror.Rotate((i + 0.5) * radius, z, org);

      for (int j = 3;j > 0; j--)
      {
        Curve c1 = edge_in[0].DuplicateCurve();
        c1.Transform(Rhino.Geometry.Transform.Scale(pl, out_in_scale * (0.8 + 0.2 * ( Math.Sin(Math.PI * Math.Pow(2, -j)))), 1, 1));
        c1.Rotate((i + Math.Pow(2, -j)) * radius, z, org);
        edge_mid.Add(c1);
        Curve c2 = c1.DuplicateCurve();
        c2.Transform(Rhino.Geometry.Transform.Mirror(mirror));
        edge_mid.Add(c2);

        double r_s = Math.PI * 0.4 * width * 0.2 * 1 / 3 * Math.Pow(2, -j);
        double r_l = Math.PI * 1.6 * width * 0.2 * 1 / 3 * Math.Pow(2, -j);

        double crvLength = c1.GetLength();
        double dot_Count = Math.Round((0.5 * crvLength ) / (r_s + r_l) - 2);
        List<Circle> circle = new List<Circle>();
        for (int k = 0; k < dot_Count + 1 ; k++)
        {
          double r = r_s + (k * (r_l - r_s) / (dot_Count ));
          double length_sum = (r_s + r) * (k + 1);

          Point3d dotOrg_c1 = c1.PointAtLength(length_sum);
          double parameter1;
          c1.ClosestPoint(dotOrg_c1, out parameter1);


          Vector3d curvaturec1 = c1.CurvatureAt(parameter1);
          Plane dotBasec1 = new Plane(dotOrg_c1, curvaturec1);
          Circle circle1 = new Circle(dotBasec1, r * 0.8);
          circle1.Rotate(Math.PI * ( Math.Pow(2, -j) - 0.5), z);
          circle1.Transform(Rhino.Geometry.Transform.Translation(curvaturec1 * 10));
          Polyline poly1 = Polyline.CreateInscribedPolygon(circle1, 12);
          Mesh mesh1 = Mesh.CreateFromClosedPolyline(poly1);
          Mesh mesh2 = Mesh.CreateFromClosedPolyline(poly1);


          Point3d dotOrg_c3 = c1.PointAtLength(crvLength - length_sum);
          double parameter3;
          c1.ClosestPoint(dotOrg_c3, out parameter3);
          Vector3d curvaturec3 = c1.CurvatureAt(parameter3);
          Plane dotBasec3 = new Plane(dotOrg_c3, curvaturec3);
          Circle circle3 = new Circle(dotBasec3, r * 0.8);
          circle3.Rotate(Math.PI * ( Math.Pow(2, -j) - 0.5), z);
          circle3.Transform(Rhino.Geometry.Transform.Translation(curvaturec3 * 10));
          Polyline poly3 = Polyline.CreateInscribedPolygon(circle3, 12);
          Mesh mesh3 = Mesh.CreateFromClosedPolyline(poly3);
          Mesh mesh4 = Mesh.CreateFromClosedPolyline(poly3);

          mesh2.Transform(Rhino.Geometry.Transform.Mirror(mirror));
          mesh4.Transform(Rhino.Geometry.Transform.Mirror(mirror));

          dot.Add(mesh1);
          dot.Add(mesh2);
          dot.Add(mesh3);
          dot.Add(mesh4);

        }
      }
    }

    // Brep
    List<Curve> brepCrv = new List<Curve>();
    List<Point3d> cap_Point = new List<Point3d>();
    for (int i = 0; i < pumCol ;i++)
    {
      brepCrv.Add(edge_in[i]);
      brepCrv.Add(edge_mid[(i * 6)]);
      brepCrv.Add(edge_mid[(i * 6) + 2]);
      brepCrv.Add(edge_mid[(i * 6) + 4]);
      brepCrv.Add(edge_mid[(i * 6) + 3]);
      brepCrv.Add(edge_mid[(i * 6) + 1]);

      cap_Point.Add(edge_in[i].PointAtEnd);
      cap_Point.Add(edge_mid[(i * 6)].PointAtEnd);
      cap_Point.Add(edge_mid[(i * 6) + 2].PointAtEnd);
      cap_Point.Add(edge_mid[(i * 6) + 4].PointAtEnd);
      cap_Point.Add(edge_mid[(i * 6) + 3].PointAtEnd);
      cap_Point.Add(edge_mid[(i * 6) + 1].PointAtEnd);

    }
    cap_Point.Add(edge_in[0].PointAtEnd);


    // stem
    ctrPt_tp.Add(ctrPt_tp[0]);
    Point3d org_top = new Point3d (org.X, org.Y, org.Z + height);
    Plane plane = new Plane(org_top, z);

    //cap
    Curve pumpkin_cap = Curve.CreateControlPointCurve(cap_Point, 3);
    Curve pumpkin_top = Curve.CreateControlPointCurve(ctrPt_tp, 3);

    pumpkin_top.Transform(Rhino.Geometry.Transform.Scale(plane, 1.3, 1.3, 1));


    Curve stem_bot = pumpkin_top.DuplicateCurve();
    stem_bot.Transform(Rhino.Geometry.Transform.Scale(plane, 0.3, 0.3, 1));
    Curve stem_top = pumpkin_top.DuplicateCurve();
    Vector3d offset = new Vector3d (0, 0, 0.15 * height);
    stem_top.Transform(Rhino.Geometry.Transform.Translation(offset));
    Point3d stemcenter_top = stem_top.PointAt(x);

    Point3d stemcenter_mid = org_top;
    stemcenter_mid.Transform(Rhino.Geometry.Transform.Translation(0.6 * offset));


    List<Point3d> stem_center_point = new List<Point3d>();
    stem_center_point.Add(org_top);
    stem_center_point.Add(stemcenter_mid);
    stem_center_point.Add(stemcenter_top);
    Curve stem_center = Curve.CreateControlPointCurve(stem_center_point, 3);

    List<Curve> cap_loft = new List<Curve>();
    Curve pumpkin_cap_up = pumpkin_cap.DuplicateCurve();
    pumpkin_cap_up.Transform(Rhino.Geometry.Transform.Translation(0.1 * offset));

    cap_loft.Add(pumpkin_cap);
    cap_loft.Add(pumpkin_cap_up);

    Brep[] stem = Brep.CreateFromSweep(stem_center, stem_bot, true, 1);
    Brep[] pumpkin = Brep.CreateFromLoft(brepCrv, Point3d.Unset, Point3d.Unset, LoftType.Normal, true);
    Brep[] cap_brep = Brep.CreatePlanarBreps(pumpkin_cap, 1);

    D = cap_brep;
    C = pumpkin;
    E = dot;
    F = stem;
# ---------- end c_script_5 ----------
geo = Geometry([c_script_5.F, c_script_5.D, c_script_5.E])

srf = Surface(c_script_5.F)
rebuild_surface = RebuildSurface(Surface=srf, UDegree=3, VDegree=3, UNumber=10, VNumber=10)
mesh = Mesh(c_script_5.E)
divide_surface = DivideSurface(Surface=rebuild_surface, UCount=Slider(5, range=0..10), VCount=Slider(9, range=0..100))  # -> Points, Normals, Parameters
c_script_6 = CSharpScript(origin=divide_surface.Points, normal=divide_surface.Normals)  # -> out, plane; inputs origin: list of Point3d, normal: list of Vector3d
# ---------- c_script_6: C# ----------
    List<Plane> plane1 = new List<Plane>();
    for (int i = 0; i < origin.Count; i++)
    {
      Plane P = new Plane(origin[i], normal[i]);
      plane1.Add(P);
    }
    plane = plane1;
# ---------- end c_script_6 ----------
circle = Circle(Plane=c_script_6.plane, Radius=Slider(2, range=0..10))
boundary = BoundarySurfaces(Edges=circle)

rgb = ColourRGB(Alpha=255, Red="255", Green=0, Blue=0)
rgb_2 = ColourRGB(Alpha=255, Red="255", Green="255", Blue="255")
preview = CustomPreview(Geometry=[c_script_5.C, boundary], Material=rgb_2)
# Bounding Sphere
preview_2 = CustomPreview(Geometry=geo, Material=rgb)
