# Grasshopper definition world.gh (Grasshopper 1.0.7)
# plug-ins: Noise 4D

size = Slider(10.387, range=0..40)
f = Slider(46, range=0..60)
f_2 = Slider(60, range=0..60)
# 2.Turn on timer
timer = Timer(TimerInterval=20, Target=[c_script, c_script_7])  # disabled
# 3. Press Button
button = Button()
c_script = CSharpScript(reset=button)  # -> out, framerate; inputs reset: Boolean
# ---------- c_script: C# usings ----------
using System.IO;
using System.Linq;
using System.Data;
using System.Drawing;
using System.Reflection;
using System.Windows.Forms;
using System.Xml;
using System.Xml.Linq;
using System.Runtime.InteropServices;

using Rhino.DocObjects;
using Rhino.Collections;
using GH_IO;
using GH_IO.Serialization;
# ---------- c_script: C# ----------
    num = reset ? 0 : num + 1;
    framerate = num;
    Print(num.ToString());
# ---------- c_script: C# additional code ----------
  private int num = 0;
# ---------- end c_script ----------
msphere = MeshSphere(Base=PlaneXY(0, 0, 0), Radius=size, UCount=f, VCount=f_2)
panel = Panel(c_script.framerate)
mcomp = Decompose(Mesh=msphere)  # -> Vertices, Faces, Colours, Normals

pdecon = Deconstruct(Point=mcomp.Vertices)  # -> XComponent, YComponent, ZComponent
c_script_2 = CSharpScript(x=c_script.framerate)  # -> out, A; inputs x: Double
# ---------- c_script_2: C# ----------
    A = (Math.Sin(x) + 1) / 2 * 0.35;
# ---------- end c_script_2 ----------
c_script_3 = CSharpScript(x=c_script.framerate)  # -> out, A; inputs x: Double
# ---------- c_script_3: C# ----------
    A = (Math.Sin(x) + 1) * 9;
# ---------- end c_script_3 ----------
c_script_4 = CSharpScript(x=pdecon.XComponent, y=c_script_2.A)  # -> out, A; inputs x: Double, y: Double
# ---------- c_script_4: C# ----------
    A = Math.Cos(x * Math.PI * 0.5 + y);
# ---------- end c_script_4 ----------
c_script_5 = CSharpScript(x=pdecon.YComponent, y=c_script_2.A)  # -> out, A; inputs x: Double, y: Double; same code as c_script_4
c_script_6 = CSharpScript(x=pdecon.ZComponent)  # -> out, A; inputs x: Double
# ---------- c_script_6: C# ----------
    A = Math.Cos(x * Math.PI * 0.5 + Math.PI * 0.5);
# ---------- end c_script_6 ----------
cos = Cosine(Value=c_script_2.A)
sqr = Square(Value=pdecon.XComponent)
sqr_2 = Square(Value=pdecon.YComponent)
sqr_3 = Square(Value=pdecon.ZComponent)
addition = Addition(A=c_script_4.A, B=c_script_5.A, C=c_script_6.A, D=cos)
addition_2 = Addition(A=addition, B=sqr, C=sqr_2, D=sqr_3)

amplitude = Slider(9.592, range=0..12)
scale = Slider(0.188, range=0..1)
simplex = SimplexNoise(Values=mcomp.Vertices, Time=c_script_2.A, Scale=scale)
gradient = Gradient(LowerLimit=-1, UpperLimit=1, Parameter=simplex, stops=[0: RGB(255, 228, 225), 0.157: RGB(255, 69, 0), 1: RGB(139, 0, 0)])
multiplication = Multiplication(A=simplex, B=amplitude)
division = Division(A=mcomp.Vertices, B=addition_2)
multiplication_2 = Multiplication(A=division, B=Slider(10000, range=0..10000))
multiplication_3 = Multiplication(A=mcomp.Normals, B=multiplication)
# 1. Press Button
move = Move(Geometry=multiplication_2, Motion=multiplication_3)  # -> Geometry, Transform
c_script_7 = CSharpScript(reset=Button(), startPts=multiplication_2, targetPts=move.Geometry)  # -> out, A, B, C; inputs reset: Boolean, startPts: list of Point3d, targetPts: list of Point3d
# ---------- c_script_7: C# ----------
    //Empty point list and speed list
    ptList = new List<Point3d>();
    speedList = new List<Vector3d>();
    tpList = targetPts;

    // Reset the agent simulation
    if(reset){
      //empty the agent list
      agentList = new List<Agent>();
      simulationCount = 0;

      //declare the agents and add to the agent list
      for(int i = 0; i < startPts.Count; i++){
        Agent agent01 = new Agent(startPts[i]);
        agentList.Add(agent01);
      }
    }

      //Run the agent simulation
    else{

      //Run the agent simulation

      for(int i = 0; i < agentList.Count; i++){
        //Run agents
        Agent agent01 = agentList[i];
        agent01.run(i);

        //Update the location list and speed list
        ptList.Add(agent01.loc);
        speedList.Add(agent01.speed);
      }

      /*
      System.Threading.Tasks.Parallel.For(0, agentList.Count, i => {
        {
          //Run agents
          Agent agent01 = agentList[i];
          agent01.run();

          lock(agentList){
            //Update the location list and speed list
            ptList.Add(agent01.loc);
            speedList.Add(agent01.speed);
          }
        }
        });
      */

      //Add one value to the simulation count
      simulationCount++;
    }

    A = ptList;
    B = speedList;
    C = simulationCount;
# ---------- c_script_7: C# additional code ----------
  //Global Variable List
  static List<Agent> agentList = new List<Agent>();
  static List<Point3d> ptList = new List<Point3d>();
  static List<Vector3d> speedList = new List<Vector3d>();

  static List<Point3d> tpList;

  static int simulationCount;

  //Agent
  public class Agent{
    //Class variables
    public Point3d loc = new Point3d();
    public Vector3d speed = new Vector3d();

    Vector3d accel = new Vector3d();
    double maxSpeed = 1.00;

    //Class constructor
    public Agent(Point3d _loc){
      loc = _loc;
    }

    public void run(int i){
      move();
      attract(i);
    }

    //move each agent based on a speed vector
    void move(){
      //speed = new Vector3d(0, 0, 0);
      speed += accel;
      if(speed.Length > maxSpeed){
        speed.Unitize();
        speed *= maxSpeed;
      }
      loc += speed;

      accel = new Vector3d(0, 0, 0);
    }

    void expand(){
      Vector3d dir = new Vector3d();
      Point3d center = new Point3d();
      Vector3d v1 = loc - center;
      v1.Unitize();
      dir += v1;
      dir *= 2;

      accel += dir;
    }

    void attract(int i){
      Vector3d dir = new Vector3d();
      Point3d center = tpList[i];
      Vector3d v1 = center - loc;
      v1.Unitize();
      dir += v1;
      dir *= 2;

      accel += dir;
    }

    void wave(){
      Vector3d dir = new Vector3d();
      Point3d center = new Point3d();
      Vector3d v1 = loc - center;
      v1.Unitize();
      dir += v1;


    }
  }

  //Instantiate only once using clock
  RangedRandom rand = new RangedRandom();


  //New RangedRandom class definition that inherits from System.Random
  class RangedRandom : System.Random
  {
    //clock-seeded constructor
    public RangedRandom(): base(){}

    //seeded constructor
    public RangedRandom(int seed): base(seed){}

    public double NextDouble(double max){
      return NextDouble() * max;
    }

    public double NextDouble(double min, double max){
      return (max - min) * NextDouble() + min;
    }
  }
# ---------- end c_script_7 ----------
mesh = Mesh(Vertices=c_script_7.A, Faces=mcomp.Faces, Colours=gradient)
