# Grasshopper definition yayoi kusama's planet 1026.gh (Grasshopper 1.0.7)
# plug-ins: Noise 4D, Kangaroo2 Components, Panda

timer = Timer(TimerInterval=50, Target=c_script)  # disabled
c_script = CSharpScript(reset=Button())  # -> out, framerate; inputs reset: Boolean
# ---------- c_script: C# usings ----------
using System.IO;
using System.Linq;
using System.Data;
using System.Drawing;
using System.Reflection;
using System.Windows.Forms;
using System.Xml;
using System.Xml.Linq;
using System.Runtime.InteropServices;

using Rhino.DocObjects;
using Rhino.Collections;
using GH_IO;
using GH_IO.Serialization;
# ---------- c_script: C# ----------
    num = reset ? 0 : num + 1;
    framerate = num;
    Print(num.ToString());
# ---------- c_script: C# additional code ----------
  private int num = 0;
# ---------- end c_script ----------
panel = Panel(c_script.framerate)
addition = Addition(A=panel, B=Slider(50, range=0..100))

pt = ConstructPoint(XCoordinate=Slider(0, range=0..100), YCoordinate=Slider(0, range=0..100), ZCoordinate=Slider(200, range=0..100000))
X = UnitX(Factor=1)
Y = UnitY(Factor=1)
pl = ConstructPlane(Origin=pt, XAxis=X, YAxis=Y)
mbox = MeshBox(Base=pl, XCount=10, YCount=10, ZCount=10)

c_script_2 = CSharpScript(x=c_script.out)  # -> out, A; inputs x: Double
# ---------- c_script_2: C# ----------
    A = (  (Math.Abs(Math.Sin(x / 10)) + 0.2 ) * 25);
    if (x ==10)
    {
      for (int i = 0; i < 5; i++)
      {
        A = (  (Math.Abs(Math.Sin(10 / 10)) + 0.2 ) * 25);
      }
    }
# ---------- end c_script_2 ----------
c_script_3 = CSharpScript(x=c_script.framerate)  # -> out, A; inputs x: Double
# ---------- c_script_3: C# ----------
    A = (  (Math.Abs(Math.Sin(x / 10)) + 0.2 ) * 25 / 6);
# ---------- end c_script_3 ----------
c_script_4 = CSharpScript(x=c_script.framerate)  # -> out, A; inputs x: Double
# ---------- c_script_4: C# ----------
    A = (  (Math.Abs(Math.Sin(x / 10)) ) * 10);
# ---------- end c_script_4 ----------
c_script_5 = CSharpScript(x=c_script.framerate)  # -> out, A; inputs x: Double
# ---------- c_script_5: C# ----------
    A = (  (Math.Abs(Math.Sin(x / 10)) ) * 25 / 50);
# ---------- end c_script_5 ----------

# ----
# growing sphere
timer_2 = Timer(TimerInterval=20, Target=[c_script_6, c_script_12])  # disabled
button = Button()  # disabled
size = Slider(10.387, range=0..40)  # disabled
f = Slider(46, range=0..60)  # disabled
f_2 = Slider(60, range=0..60)  # disabled
c_script_6 = CSharpScript(reset=button)  # -> out, framerate; inputs reset: Boolean; disabled; same code as c_script
msphere = MeshSphere(Base=PlaneXY(0, 0, 0), Radius=size, UCount=f, VCount=f_2)  # disabled
panel_2 = Panel(c_script_6.framerate)  # disabled
mcomp = Decompose(Mesh=msphere)  # -> Vertices, Faces, Colours, Normals; disabled
viewer = ParamViewer(mcomp.Vertices)  # disabled
amplitude = Slider(9.592, range=0..12)  # disabled
scale = Slider(0.188, range=0..1)  # disabled
number_slider = Slider(3000, range=0..10000)  # disabled
button_2 = Button()  # disabled

c_script_7 = CSharpScript(x=c_script_6.framerate)  # -> out, A; inputs x: Double; disabled
# ---------- c_script_7: C# ----------
    A = (Math.Sin(x) + 1) / 2 * 0.35;
# ---------- end c_script_7 ----------
pdecon = Deconstruct(Point=mcomp.Vertices)  # -> XComponent, YComponent, ZComponent; disabled
c_script_8 = CSharpScript(x=c_script_6.framerate)  # -> out, A; inputs x: Double; disabled
# ---------- c_script_8: C# ----------
    A = (Math.Sin(x) + 1) * 9;
# ---------- end c_script_8 ----------
c_script_9 = CSharpScript(x=pdecon.XComponent, y=c_script_7.A)  # -> out, A; inputs x: Double, y: Double; disabled
# ---------- c_script_9: C# ----------
    A = Math.Cos(x * Math.PI * 0.5 + y);
# ---------- end c_script_9 ----------
c_script_10 = CSharpScript(x=pdecon.YComponent, y=c_script_7.A)  # -> out, A; inputs x: Double, y: Double; disabled; same code as c_script_9
c_script_11 = CSharpScript(x=pdecon.ZComponent)  # -> out, A; inputs x: Double; disabled
# ---------- c_script_11: C# ----------
    A = Math.Cos(x * Math.PI * 0.5 + Math.PI * 0.5);
# ---------- end c_script_11 ----------
cos = Cosine(Value=c_script_7.A)  # disabled
sqr = Square(Value=pdecon.XComponent)  # disabled
sqr_2 = Square(Value=pdecon.YComponent)  # disabled
sqr_3 = Square(Value=pdecon.ZComponent)  # disabled
addition_2 = Addition(A=c_script_9.A, B=c_script_10.A, C=c_script_11.A, D=cos)  # disabled
addition_3 = Addition(A=addition_2, B=sqr, C=sqr_2, D=sqr_3)  # disabled

simplex = SimplexNoise(Values=mcomp.Vertices, Time=c_script_7.A, Scale=scale)  # disabled
division = Division(A=mcomp.Vertices, B=addition_3)  # disabled
multiplication = Multiplication(A=simplex, B=amplitude)  # disabled
multiplication_2 = Multiplication(A=division, B=number_slider)  # disabled
multiplication_3 = Multiplication(A=mcomp.Normals, B=multiplication)  # disabled
move = Move(Geometry=multiplication_2, Motion=multiplication_3)  # -> Geometry, Transform; disabled
c_script_12 = CSharpScript(reset=button_2, startPts=multiplication_2, targetPts=move.Geometry)  # -> out, A, B, C; inputs reset: Boolean, startPts: list of Point3d, targetPts: list of Point3d; disabled
# ---------- c_script_12: C# ----------
    //Empty point list and speed list
    ptList = new List<Point3d>();
    speedList = new List<Vector3d>();
    tpList = targetPts;

    // Reset the agent simulation
    if(reset){
      //empty the agent list
      agentList = new List<Agent>();
      simulationCount = 0;

      //declare the agents and add to the agent list
      for(int i = 0; i < startPts.Count; i++){
        Agent agent01 = new Agent(startPts[i]);
        agentList.Add(agent01);
      }
    }

      //Run the agent simulation
    else{

      //Run the agent simulation

      for(int i = 0; i < agentList.Count; i++){
        //Run agents
        Agent agent01 = agentList[i];
        agent01.run(i);

        //Update the location list and speed list
        ptList.Add(agent01.loc);
        speedList.Add(agent01.speed);
      }

      /*
      System.Threading.Tasks.Parallel.For(0, agentList.Count, i => {
        {
          //Run agents
          Agent agent01 = agentList[i];
          agent01.run();

          lock(agentList){
            //Update the location list and speed list
            ptList.Add(agent01.loc);
            speedList.Add(agent01.speed);
          }
        }
        });
      */

      //Add one value to the simulation count
      simulationCount++;
    }

    A = ptList;
    B = speedList;
    C = simulationCount;
# ---------- c_script_12: C# additional code ----------
  //Global Variable List
  static List<Agent> agentList = new List<Agent>();
  static List<Point3d> ptList = new List<Point3d>();
  static List<Vector3d> speedList = new List<Vector3d>();

  static List<Point3d> tpList;

  static int simulationCount;

  //Agent
  public class Agent{
    //Class variables
    public Point3d loc = new Point3d();
    public Vector3d speed = new Vector3d();

    Vector3d accel = new Vector3d();
    double maxSpeed = 1.00;

    //Class constructor
    public Agent(Point3d _loc){
      loc = _loc;
    }

    public void run(int i){
      move();
      attract(i);
    }

    //move each agent based on a speed vector
    void move(){
      //speed = new Vector3d(0, 0, 0);
      speed += accel;
      if(speed.Length > maxSpeed){
        speed.Unitize();
        speed *= maxSpeed;
      }
      loc += speed;

      accel = new Vector3d(0, 0, 0);
    }

    void expand(){
      Vector3d dir = new Vector3d();
      Point3d center = new Point3d();
      Vector3d v1 = loc - center;
      v1.Unitize();
      dir += v1;
      dir *= 2;

      accel += dir;
    }

    void attract(int i){
      Vector3d dir = new Vector3d();
      Point3d center = tpList[i];
      Vector3d v1 = center - loc;
      v1.Unitize();
      dir += v1;
      dir *= 2;

      accel += dir;
    }

    void wave(){
      Vector3d dir = new Vector3d();
      Point3d center = new Point3d();
      Vector3d v1 = loc - center;
      v1.Unitize();
      dir += v1;


    }
  }

  //Instantiate only once using clock
  RangedRandom rand = new RangedRandom();


  //New RangedRandom class definition that inherits from System.Random
  class RangedRandom : System.Random
  {
    //clock-seeded constructor
    public RangedRandom(): base(){}

    //seeded constructor
    public RangedRandom(int seed): base(seed){}

    public double NextDouble(double max){
      return NextDouble() * max;
    }

    public double NextDouble(double min, double max){
      return (max - min) * NextDouble() + min;
    }
  }
# ---------- end c_script_12 ----------
gradient = Gradient(LowerLimit=-1, UpperLimit=1, Parameter=simplex, stops=[0: RGB(255, 255, 255), 1: RGB(255, 0, 0)])  # disabled

# ----
# planet
mesh = Mesh(Vertices=c_script_12.A, Faces=mcomp.Faces, Colours=gradient)  # disabled

# ----
# test big sphere
# Bounding Sphere
# Bounding Sphere
# big sphere center
# inhabitants
pt_2 = Point(Point(0, 0, -2))
pt_3 = Point(pt_2)
mesh_2 = Mesh(<mesh referenced from the Rhino model>)

mesh_3 = Mesh(mesh)
colour_rgb = ColourRGB(Alpha=Slider(100, range=0..100), Red="255", Green="255", Blue="255")
c_script_13 = CSharpScript(M=mesh_3)  # -> out, C, N, shroomBase, shroomTop; inputs M: Mesh
# ---------- c_script_13: C# ----------
    // reference: Grasshoppersharp

    // Create an array with all face centers.
    Point3d[] centers = new Point3d[M.Faces.Count];
    for (int i = 0; i < M.Faces.Count; i++) {
      Point3d center = M.Faces.GetFaceCenter(i);
      centers[i] = center;
    }

    // Meshes may not contain face normal information.
    // If it isn't available, compute it.
    if (M.FaceNormals.Count != M.Faces.Count) {
      M.FaceNormals.ComputeFaceNormals();
    }
     C = centers;
     N = M.FaceNormals;
    // Outputs
# ---------- end c_script_13 ----------
custom_preview = CustomPreview(Geometry=mesh_3, Material=colour_rgb)

# ----
# distance condition
c_script_14 = CSharpScript(C=c_script_13.C, pt=pt_3, N=c_script_13.N)  # -> out, B, A; inputs C: list of Point3d, pt: Point3d, N: list of Vector3d
# ---------- c_script_14: C# ----------
    List <Point3d> mptb = new List <Point3d> ();
    List <Vector3d> normal = new List <Vector3d> ();

    //identify base points below boundary
    for (int i = 0; i < C.Count; i++)
    {
      double dis = pt.DistanceTo(C[i]);
      if (dis < 285)
      {
        mptb.Add(C[i]);
        normal.Add(N[i]);
      }
    }

    B = mptb;
    A = normal;
# ---------- c_script_14: C# additional code ----------
  /// <summary>
  /// This method will be called once every solution, before any calls to RunScript.
  /// </summary>
  public override void BeforeRunScript()
  { }
  /// <summary>
  /// This method will be called once every solution, after any calls to RunScript.
  /// </summary>
  public override void AfterRunScript()
  { }
# ---------- end c_script_14 ----------
c_script_15 = CSharpScript(x=c_script_14.B)  # -> out, A; inputs x: list of Point3d
# ---------- c_script_15: C# ----------
    List <Random> rand = new List <Random> ();
    List <int> randnum = new List <int> ();
    for(int k = 0; k < 1; k++)
    {
      for(int l = 0; l < 50; l++)
      {
        Random n = new Random();
        rand.Add(n);
        int zzz = rand[k].Next(0, x.Count);
        randnum.Add(zzz);
      }
    }
    A = randnum;
# ---------- end c_script_15 ----------
c_script_16 = CSharpScript(x=c_script_15.A)  # -> out, A; inputs x: list of Int32
# ---------- c_script_16: C# ----------
    List<int> idx = new List<int>();
    for (int i = 0;i < x.Count;i++)
    {
      if (idx.Contains(x[i]) == false)
      {
        idx.Add(x[i]);
      }
    }
    A = idx;
# ---------- end c_script_16 ----------

# ----
# distance condition
c_script_17 = CSharpScript(C=c_script_13.C, pt=pt_3)  # -> out, B; inputs C: list of Point3d, pt: Point3d
# ---------- c_script_17: C# ----------
    List <Point3d> mptb = new List <Point3d> ();

    //identify base points below boundary
    for (int i = 0; i < C.Count; i++)
    {
      double dis = pt.DistanceTo(C[i]);
      if (dis > 285)
      {
        mptb.Add(C[i]);
      }
    }

    B = mptb;
# ---------- c_script_17: C# additional code ----------
  /// <summary>
  /// This method will be called once every solution, before any calls to RunScript.
  /// </summary>
  public override void BeforeRunScript()
  { }
  /// <summary>
  /// This method will be called once every solution, after any calls to RunScript.
  /// </summary>
  public override void AfterRunScript()
  { }
# ---------- end c_script_17 ----------
c_script_18 = CSharpScript(x=c_script_17.B)  # -> out, A; inputs x: list of Point3d
# ---------- c_script_18: C# ----------
    List <Random> rand = new List <Random> ();
    List <int> randnum = new List <int> ();
    for(int k = 0; k < 1; k++)
    {
      for(int l = 0; l < 200; l++)
      {
        Random n = new Random();
        rand.Add(n);
        int zzz = rand[k].Next(0, x.Count);
        randnum.Add(zzz);
      }
    }
    A = randnum;
# ---------- end c_script_18 ----------
c_script_19 = CSharpScript(x=c_script_18.A)  # -> out, A; inputs x: list of Int32; same code as c_script_16

c_script_20 = CSharpScript(C=c_script_14.B, normal=c_script_14.A, pt=pt_3, idx=c_script_16.A)  # -> out, A, pumpkinBase, pumpkinVec, vec_up, B; inputs C: list of Point3d, normal: list of Vector3d, pt: Point3d, idx: list of Int32
# ---------- c_script_20: C# ----------
    List <Point3d> mptb = new List <Point3d> ();
    List <Point3d> mptt = new List <Point3d> ();
    List <Vector3d> v = new List <Vector3d>();
    List <Vector3d> up = new List <Vector3d> ();

    //identify base points below boundary
    for (int i = 0; i < C.Count; i++)
    {
      double dis = pt.DistanceTo(C[i]);
      if (dis < 300)
      {
        mptb.Add(C[i]);
      }
    }
    //Generate random numbers for basepoints

    List <Point3d> random_base = new List <Point3d> ();

    for(int l = 0; l < idx.Count; l++)
    {

      int zzz = idx[l];
      v.Add(normal[zzz]);
      Point3d o = new Point3d(0, 0, 0);
      Vector3d z = new Vector3d (0, 0, -1);
      Vector3d pointto = new Vector3d(mptb[zzz]);
      z.Transform(Rhino.Geometry.Transform.Translation(pointto));
      up.Add(z);
      random_base.Add(C[zzz]);
    }


    pumpkinBase = random_base;
    pumpkinVec = v;
    vec_up = up;
    B = mptb;
# ---------- c_script_20: C# additional code ----------
  /// <summary>
  /// This method will be called once every solution, before any calls to RunScript.
  /// </summary>
  public override void BeforeRunScript()
  { }
  /// <summary>
  /// This method will be called once every solution, after any calls to RunScript.
  /// </summary>
  public override void AfterRunScript()
  { }
# ---------- end c_script_20 ----------

c_script_21 = CSharpScript(x=addition)  # -> out, A; inputs x: Double
# ---------- c_script_21: C# ----------
    A = ( 70 * Math.Abs(Math.Sin(x / 10)) * 3) + 100;
# ---------- end c_script_21 ----------
c_script_22 = CSharpScript(x=addition)  # -> out, A; inputs x: Double
# ---------- c_script_22: C# ----------
    A = ( Math.Abs(Math.Sin(x / 10)) * 3) + 0.5;
# ---------- end c_script_22 ----------
c_script_23 = CSharpScript(x=addition)  # -> out, A; inputs x: Double
# ---------- c_script_23: C# ----------
    A = (x % 10) * 0.5;
# ---------- end c_script_23 ----------
round = Round(Number=c_script_21.A)  # -> Nearest, Floor, Ceiling
pt_4 = Point(c_script_20.pumpkinBase)

# ----
# pumpkin
c_script_24 = CSharpScript(org=c_script_20.pumpkinBase, pumCol="8", height=round.Floor, ratio=c_script_22.A, x=c_script_23.A)  # -> out, D, C, E, F; inputs org: Point3d, pumCol: Int32, height: Double, ratio: Double, x: Double, angle: Double
# ---------- c_script_24: C# ----------
    //pumpkin surf
    double width = height / ratio;
    double radius = 2 * Math.PI / pumCol;
    List<List<Point3d>> ctrList = new List<List<Point3d>> ();
    List<Curve> edge_in = new List<Curve>();
    List<Curve> edge_out = new List<Curve>();
    List<Curve> edge_mid = new List<Curve>();
    Vector3d z = new Vector3d(0, 0, 1);
    Vector3d y = new Vector3d(0, 1, 0);


    List<double> widthList = new List<double>();
    widthList.Add(1.6);
    widthList.Add(1.7);
    widthList.Add(1.5);
    widthList.Add(1);
    widthList.Add(0.9);
    widthList.Add(0.6);

    //bottom
    List<Point3d > ctrPt_bt = new List<Point3d>();
    for (int i = 0; i < pumCol;i++)
    {

      Point3d Pt = org;
      Vector3d vec = new Vector3d(width * 0.4, 0, 0);
      vec.Rotate(i * radius, z);
      Pt.Transform(Rhino.Geometry.Transform.Translation(vec));
      ctrPt_bt.Add(Pt);
    }
    ctrList.Add(ctrPt_bt);

    //body
    for( int j = 0 ; j < widthList.Count; j++)
    {
      Vector3d up = new Vector3d(0, 0, j * height / 5);
      Point3d orgPt = org;
      orgPt.Transform(Rhino.Geometry.Transform.Translation(up));
      List<Point3d> ctrPt = new List<Point3d> ();
      ctrList.Add(ctrPt);

      for (int i = 0; i < pumCol;i++)
      {
        Point3d Pt = orgPt;
        Vector3d vec = new Vector3d(widthList[j] * width, 0, 0);
        vec.Rotate(i * radius, z);
        Pt.Transform(Rhino.Geometry.Transform.Translation(vec));
        ctrPt.Add(Pt);
      }
    }

    //Top
    List<Point3d > ctrPt_tp = new List<Point3d>();
    for (int i = 0; i < pumCol;i++)
    {
      Vector3d up = new Vector3d(0, 0, height);
      Point3d orgPt = org;
      orgPt.Transform(Rhino.Geometry.Transform.Translation(up));
      Point3d Pt = orgPt;
      Vector3d vec = new Vector3d(width * 0.4, 0, 0);
      vec.Rotate(i * radius, z);
      Pt.Transform(Rhino.Geometry.Transform.Translation(vec));
      ctrPt_tp.Add(Pt);
    }
    ctrList.Add(ctrPt_tp);

    // edge inner
    for (int i = 0; i < pumCol;i++)
    {
      List < Point3d > edgePt = new List<Point3d>();
      for(int j = 0; j < widthList.Count + 2; j++)
      {
        Point3d pt = ctrList[j][i];
        edgePt.Add(pt);
      }

      Curve c = Curve.CreateControlPointCurve(edgePt, 3);
      edge_in.Add(c);
    }
    edge_in.Add(edge_in[0]);

    // edge outer
    for (int i = 0; i < pumCol;i++)
    {
      Curve c = edge_in[0].DuplicateCurve();
      Plane pl = new Plane(org, z);
      c.Transform(Rhino.Geometry.Transform.Scale(pl, 1.2, 1, 1));
      c.Rotate((i + 0.5) * radius, z, org);
      edge_out.Add(c);
    }

    // edge mid + dot
    List<Mesh> dot = new List<Mesh>();
    List<Sphere> Dot = new List<Sphere>();
    for (int i = 0; i < pumCol;i++)
    {
      Plane pl = new Plane(org, z);
      double out_in_scale = 1.2;

      Plane mirror = new Plane (org, y);
      mirror.Rotate((i + 0.5) * radius, z, org);

      for (int j = 3;j > 0; j--)
      {
        Curve c1 = edge_in[0].DuplicateCurve();
        c1.Transform(Rhino.Geometry.Transform.Scale(pl, out_in_scale * (0.8 + 0.2 * ( Math.Sin(Math.PI * Math.Pow(2, -j)))), 1, 1));
        c1.Rotate((i + Math.Pow(2, -j)) * radius, z, org);
        edge_mid.Add(c1);
        Curve c2 = c1.DuplicateCurve();
        c2.Transform(Rhino.Geometry.Transform.Mirror(mirror));
        edge_mid.Add(c2);

        double r_s = Math.PI * 0.4 * width * 0.2 * 1 / 3 * Math.Pow(2, -j);
        double r_l = Math.PI * 1.6 * width * 0.2 * 1 / 3 * Math.Pow(2, -j);

        double crvLength = c1.GetLength();
        double dot_Count = Math.Round((0.5 * crvLength ) / (r_s + r_l) - 2);
        List<Circle> circle = new List<Circle>();
        for (int k = 0; k < dot_Count + 1 ; k++)
        {
          double r = r_s + (k * (r_l - r_s) / (dot_Count ));
          double length_sum = (r_s + r) * (k + 1);

          Point3d dotOrg_c1 = c1.PointAtLength(length_sum);
          double parameter1;
          c1.ClosestPoint(dotOrg_c1, out parameter1);


          Vector3d curvaturec1 = c1.CurvatureAt(parameter1);
          Plane dotBasec1 = new Plane(dotOrg_c1, curvaturec1);
          Circle circle1 = new Circle(dotBasec1, r * 0.8);
          circle1.Rotate(Math.PI * ( Math.Pow(2, -j) - 0.5), z);
          circle1.Transform(Rhino.Geometry.Transform.Translation(curvaturec1 * 10));
          Polyline poly1 = Polyline.CreateInscribedPolygon(circle1, 12);
          Mesh mesh1 = Mesh.CreateFromClosedPolyline(poly1);
          Mesh mesh2 = Mesh.CreateFromClosedPolyline(poly1);


          Point3d dotOrg_c3 = c1.PointAtLength(crvLength - length_sum);
          double parameter3;
          c1.ClosestPoint(dotOrg_c3, out parameter3);
          Vector3d curvaturec3 = c1.CurvatureAt(parameter3);
          Plane dotBasec3 = new Plane(dotOrg_c3, curvaturec3);
          Circle circle3 = new Circle(dotBasec3, r * 0.8);
          circle3.Rotate(Math.PI * ( Math.Pow(2, -j) - 0.5), z);
          circle3.Transform(Rhino.Geometry.Transform.Translation(curvaturec3 * 10));
          Polyline poly3 = Polyline.CreateInscribedPolygon(circle3, 12);
          Mesh mesh3 = Mesh.CreateFromClosedPolyline(poly3);
          Mesh mesh4 = Mesh.CreateFromClosedPolyline(poly3);

          mesh2.Transform(Rhino.Geometry.Transform.Mirror(mirror));
          mesh4.Transform(Rhino.Geometry.Transform.Mirror(mirror));

          dot.Add(mesh1);
          dot.Add(mesh2);
          dot.Add(mesh3);
          dot.Add(mesh4);

        }
      }
    }

    // Brep
    List<Curve> brepCrv = new List<Curve>();
    List<Point3d> cap_Point = new List<Point3d>();
    for (int i = 0; i < pumCol ;i++)
    {
      brepCrv.Add(edge_in[i]);
      brepCrv.Add(edge_mid[(i * 6)]);
      brepCrv.Add(edge_mid[(i * 6) + 2]);
      brepCrv.Add(edge_mid[(i * 6) + 4]);
      brepCrv.Add(edge_mid[(i * 6) + 3]);
      brepCrv.Add(edge_mid[(i * 6) + 1]);

      cap_Point.Add(edge_in[i].PointAtEnd);
      cap_Point.Add(edge_mid[(i * 6)].PointAtEnd);
      cap_Point.Add(edge_mid[(i * 6) + 2].PointAtEnd);
      cap_Point.Add(edge_mid[(i * 6) + 4].PointAtEnd);
      cap_Point.Add(edge_mid[(i * 6) + 3].PointAtEnd);
      cap_Point.Add(edge_mid[(i * 6) + 1].PointAtEnd);

    }
    cap_Point.Add(edge_in[0].PointAtEnd);


    // stem
    ctrPt_tp.Add(ctrPt_tp[0]);
    Point3d org_top = new Point3d (org.X, org.Y, org.Z + height);
    Plane plane = new Plane(org_top, z);

    //cap
    Curve pumpkin_cap = Curve.CreateControlPointCurve(cap_Point, 3);
    Curve pumpkin_top = Curve.CreateControlPointCurve(ctrPt_tp, 3);

    pumpkin_top.Transform(Rhino.Geometry.Transform.Scale(plane, 1.3, 1.3, 1));


    Curve stem_bot = pumpkin_top.DuplicateCurve();
    stem_bot.Transform(Rhino.Geometry.Transform.Scale(plane, 0.3, 0.3, 1));
    Curve stem_top = pumpkin_top.DuplicateCurve();
    Vector3d offset = new Vector3d (0, 0, 0.15 * height);
    stem_top.Transform(Rhino.Geometry.Transform.Translation(offset));
    Point3d stemcenter_top = stem_top.PointAt(x);

    Point3d stemcenter_mid = org_top;
    stemcenter_mid.Transform(Rhino.Geometry.Transform.Translation(0.6 * offset));


    List<Point3d> stem_center_point = new List<Point3d>();
    stem_center_point.Add(org_top);
    stem_center_point.Add(stemcenter_mid);
    stem_center_point.Add(stemcenter_top);
    Curve stem_center = Curve.CreateControlPointCurve(stem_center_point, 3);

    List<Curve> cap_loft = new List<Curve>();
    Curve pumpkin_cap_up = pumpkin_cap.DuplicateCurve();
    pumpkin_cap_up.Transform(Rhino.Geometry.Transform.Translation(0.1 * offset));

    cap_loft.Add(pumpkin_cap);
    cap_loft.Add(pumpkin_cap_up);

    Brep[] stem = Brep.CreateFromSweep(stem_center, stem_bot, true, 1);
    Brep[] pumpkin = Brep.CreateFromLoft(brepCrv, Point3d.Unset, Point3d.Unset, LoftType.Normal, true);
    Brep[] cap_brep = Brep.CreatePlanarBreps(pumpkin_cap, 1);

    D = cap_brep;
    C = pumpkin;
    E = dot;
    F = stem;
# ---------- end c_script_24 ----------
pt_5 = Point(graft(pt_4))
geo = Geometry([c_script_24.F, c_script_24.D, c_script_24.E])
scale_2 = Scale(Geometry=c_script_24.C, Center=pt_5, Factor="0.1")  # -> Geometry, Transform
scale_3 = Scale(Geometry=geo, Center=pt_5, Factor="0.1")  # -> Geometry, Transform

# ----
# mushroom
c_script_25 = CSharpScript(C=c_script_13.C, normal=c_script_13.N, pt=pt_3, idx=c_script_19.A)  # -> out, A, mushroomBase, mushroomVec, mushroom_vecup; inputs C: list of Point3d, normal: list of Vector3d, pt: Point3d, idx: list of Int32
# ---------- c_script_25: C# ----------
    List <Point3d> mptb = new List <Point3d> ();
    List <Point3d> mptt = new List <Point3d> ();
    List <Vector3d> v = new List <Vector3d> ();
    List <Vector3d> dir = new List <Vector3d> ();
    List <Vector3d> up = new List <Vector3d> ();

    //Generate random numbers for basepoints


    List <Point3d> random_base = new List <Point3d> ();
    for(int l = 0; l < idx.Count; l++)
    {
      int zzz = idx[l];
      random_base.Add(C[zzz]);
      v.Add(normal[zzz]);
      Point3d o = new Point3d(0, 0, 0);
      Vector3d z = new Vector3d (0, 0, -1);
      Vector3d pointto = new Vector3d(C[zzz]);
      z.Transform(Rhino.Geometry.Transform.Translation(pointto));
      up.Add(z);
    }

    mushroomBase = random_base;
    mushroomVec = v;
    mushroom_vecup = up;
# ---------- c_script_25: C# additional code ----------
  /// <summary>
  /// This method will be called once every solution, before any calls to RunScript.
  /// </summary>
  public override void BeforeRunScript()
  { }
  /// <summary>
  /// This method will be called once every solution, after any calls to RunScript.
  /// </summary>
  public override void AfterRunScript()
  { }
# ---------- end c_script_25 ----------
c_script_26 = CSharpScript(C=c_script_25.mushroomBase, x=c_script_25.mushroomVec, pt=pt_3, t=c_script_2.A)  # -> out, A, shroomTop; inputs C: list of Point3d, x: list of Vector3d, pt: Point3d, t: Double
# ---------- c_script_26: C# ----------
    List <Point3d> mptt = new List <Point3d> ();
    List <Vector3d> dir = new List <Vector3d> ();

    //Generate random numbers for vectors
    //random num for x,y directions
    List <Random> rand = new List <Random> ();
    List <double> randnum = new List <double> ();

    for(int k = 0; k < 1; k++)
    {
      for(int l = 0; l < x.Count; l++)
      {
        Random n = new Random();
        rand.Add(n);
        double zzz = rand[k].Next(-2, 2);
        randnum.Add(zzz);
      }
    }
    List <Random> rand1 = new List <Random> ();
    List <double> randnum1 = new List <double> ();

    //random num for x,y directions
    for(int k = 0; k < 1; k++)
    {
      for(int l = 0; l < x.Count; l++)
      {
        Random n = new Random();
        rand1.Add(n);
        double zzz = rand1[k].NextDouble() + 1;
        randnum1.Add(zzz);
      }
    }

    //generate vector and top points
    for(int j = 0; j < x.Count; j++)
    {
      Vector3d dirtemp = new Vector3d(randnum[j], randnum[j], randnum[j] * 1.5 + t);
      dir.Add(dirtemp);
      mptt.Add(C[j] + dir[j]);
    }
    shroomTop = mptt;
# ---------- c_script_26: C# additional code ----------
  /// <summary>
  /// This method will be called once every solution, before any calls to RunScript.
  /// </summary>
  public override void BeforeRunScript()
  { }
  /// <summary>
  /// This method will be called once every solution, after any calls to RunScript.
  /// </summary>
  public override void AfterRunScript()
  { }
# ---------- end c_script_26 ----------

scale_4 = Scale(Geometry=c_script_24.E, Center=pt_5, Factor="0.1")  # -> Geometry, Transform
geo_2 = Geometry(scale_4.Geometry)
geo_3 = Geometry(scale_3.Geometry)
geo_4 = Geometry(flatten(scale_2.Geometry))
J = Join(Mesh=geo_3, Weld=True)  # -> flatten(Mesh)
J_2 = Join(Mesh=geo_2, Weld=True)  # -> flatten(Mesh)
c_script_27 = CSharpScript(org=pt_4, height=round.Floor, ratio=c_script_22.A)  # -> out, A; inputs org: list of Point3d, height: Double, ratio: Double
# ---------- c_script_27: C# ----------
    List<Point3d> center = new List<Point3d>();
    List<Sphere> bound = new List<Sphere>();
    for (int i = 0;i < org.Count;i++)
    {
      Point3d pt = new Point3d(org[i].X, org[i].Y, org[i].Z + height * 0.05);
      Sphere bounding_sphere = new Sphere(pt, 0.2 * height / ratio);
      bound.Add(bounding_sphere);
    }
    A = bound;
# ---------- end c_script_27 ----------
c_script_28 = CSharpScript(org=c_script_25.mushroomBase, top=c_script_26.shroomTop)  # -> out, A, h; inputs org: list of Point3d, top: list of Point3d
# ---------- c_script_28: C# ----------
    List<Point3d> center = new List<Point3d>();
    List<Sphere> bound = new List<Sphere>();
    for (int i = 0;i < org.Count;i++)
    {
      double height = top[i].Z - org[i].Z;
      Point3d pt = new Point3d(org[i].X, org[i].Y, org[i].Z + 0.5 * height);

      Sphere bounding_sphere = new Sphere(pt, 0.4 * height);
      bound.Add(bounding_sphere);
    }
    A = bound;
    h = top[0].Z - org[0].Z;
# ---------- end c_script_28 ----------

c_script_29 = CSharpScript(
    a=c_script_26.shroomTop,
    b=c_script_25.mushroomBase,
    c=c_script_25.mushroomVec,
    d=c_script_4.A,
    e=c_script_5.A,
    U="13",
    V="15")  # -> out, axis, A, basePt, Shroom, pts; inputs a: Point3d, b: Point3d, c: Double, d: Double, e: Double, U: Int32, V: Int32
# ---------- c_script_29: C# ----------
    //create a line from two pts

    Line base1 = new Line(a, b);
    axis = base1;
    //convert line to curve
    NurbsCurve base2 = base1.ToNurbsCurve();

    //divide to control pts
    int controlPtsNum = 20;
    Point3d [] dividedPt;
    base2.DivideByCount(controlPtsNum, true, out dividedPt);
    int divPtCount = dividedPt.Length;
    Vector3d udir = new Vector3d(base1.Direction);
    udir.Unitize();


    //alter the curve to look like a shroom
    Curve shroomCrv;

    for (int i = 0; i < divPtCount; i++)
    {
      //shroom head
      if (i < divPtCount / 3)
      {
        Vector3d v = new Vector3d(-c * Math.Sqrt(i) - udir.Z, d * udir.Y, d * udir.X);
        dividedPt[i] = dividedPt[i] + v;
      }
        //shroom body
      else if (i >= divPtCount / 3 && i < divPtCount - 1)
      {
        Vector3d v = new Vector3d(-e * Math.Sqrt(i) * -udir.Z, udir.Y, udir.X);
        dividedPt[i] = dividedPt[i] + v;
      }
    }

    shroomCrv = Curve.CreateControlPointCurve(dividedPt, 3); // create shroom curve
    A = shroomCrv;
    //revolve curve around base 1
    Line revolveAxis = new Line(shroomCrv.PointAtStart, b);
    Plane planeCir = new Plane(a, revolveAxis.Direction);
    Circle revolveCir = new Circle(planeCir, 5);
    NurbsCurve revolveCrv = revolveCir.ToNurbsCurve();

    NurbsSurface shroom = NurbsSurface.CreateRailRevolvedSurface(shroomCrv, revolveCrv, revolveAxis, false);

    //rebuild a smooth shroom
    Shroom = shroom.Rebuild(3, 3, U, V);
# ---------- end c_script_29 ----------
divide_surface = DivideSurface(Surface=c_script_29.Shroom, UCount="13", VCount="15")  # -> simplify(Points), Normals, Parameters
c_script_30 = CSharpScript(origin=flatten(divide_surface.Points), normal=flatten(divide_surface.Normals), x=c_script_28.h, base1=c_script_29.axis)  # -> out, plane, circles, O, A; inputs origin: list of Point3d, normal: list of Vector3d, x: Double, base1: Curve
# ---------- c_script_30: C# ----------
    List<Plane> plane1 = new List<Plane>();

    for (int i = 0; i < origin.Count; i++)
    {
      Plane P = new Plane(origin[i], normal[i]);
      plane1.Add(P);
    }
    plane = plane1;


    List <Circle> cir = new List<Circle>();


    for (int j = 0; j < origin.Count;j++)
    {



      Circle c = new Circle(plane1[j], x / 50);
      cir.Add(c);

    }
    circles = cir;
# ---------- end c_script_30 ----------

c_script_31 = CSharpScript(x=J, org=c_script_20.pumpkinBase, normal=c_script_20.vec_up, vec=c_script_20.pumpkinVec)  # -> out, A; inputs x: list of GeometryBase, org: list of Point3d, normal: list of Vector3d, vec: list of Vector3d
# ---------- c_script_31: C# ----------
    List<GeometryBase> geo = new  List<GeometryBase>();
    for (int i = 0;i < org.Count;i++)
    { var rotation = Transform.Rotation( normal[i],vec[i], org[i]);
      GeometryBase geo_ = x[i];
      geo_.Transform(rotation);
      geo.Add(geo_);
    }

    A = geo;
# ---------- end c_script_31 ----------
c_script_32 = CSharpScript(x=geo_4, org=c_script_20.pumpkinBase, normal=c_script_20.vec_up, vec=c_script_20.pumpkinVec)  # -> out, A; inputs x: list of GeometryBase, org: list of Point3d, normal: list of Vector3d, vec: list of Vector3d; same code as c_script_31

rgb = ColourRGB(Alpha=255, Red="255", Green="255", Blue="255")
rgb_2 = ColourRGB(Alpha=255, Red="255", Green=0, Blue=0)
preview = CustomPreview(Geometry=c_script_31.A, Material=rgb_2)
preview_2 = CustomPreview(Geometry=c_script_32.A, Material=rgb)

c_script_33 = CSharpScript(x=c_script_29.Shroom, org=c_script_25.mushroomBase, normal=c_script_25.mushroom_vecup, vec=c_script_25.mushroomVec)  # -> out, A; inputs x: list of GeometryBase, org: list of Point3d, normal: list of Vector3d, vec: list of Vector3d; same code as c_script_31

colour_rgb_2 = ColourRGB(Alpha="255", Red="255", Green="255", Blue="255")
colour_rgb_3 = ColourRGB(Alpha=255, Red="255", Green=0, Blue=0)
custom_preview_2 = CustomPreview(Geometry=c_script_33.A, Material=colour_rgb_2)
custom_preview_3 = CustomPreview(Material=colour_rgb_3)

brep = Brep(c_script_28.A)
brep_2 = Brep(c_script_27.A)
panel_3 = Panel(Slider(3, range=0..10))
number_slider_2 = Slider(10.4, range=0..200)
Z = UnitZ(Factor=1)
popgeo = PopulateGeometry(Geometry=mbox, Count=Slider(50, range=0..100), Seed=1)
multiplication_4 = Multiplication(A=Z, B="-1")
show = Show(G=popgeo)
sc = SphereCollide(Points=popgeo, Radius=panel_3, Strength=1)
load = Load(Point=popgeo, ForceVector=multiplication_4, Weighting=1)
spc = SolidPointCollide(Points=popgeo, Solid=brep_2, Interior=False, Unidirectional=True, Strength=1)
spc_2 = SolidPointCollide(Points=popgeo, Solid=brep, Interior=False, Unidirectional=True, Strength=1)
spc_3 = SolidPointCollide(Points=popgeo, Solid=mesh_3, Interior=Slider(1, range=0..1), Unidirectional=True, Strength=1)
bouncysolver = BouncySolver(
    GoalObjects=[load, show, sc, spc_2, spc_3, spc],
    Reset=Button(),
    Threshold=1e-15,
    Tolerance=0.01,
    Damping=0.99,
    Iterations=10,
    On=True)  # -> I, V, O
Z_2 = UnitZ(Factor=panel_3)
pt_6 = Point(bouncysolver.O)
move_2 = Move(Geometry=pt_6, Motion=Z_2)  # -> Geometry, Transform
msphere_2 = MeshSphere(Base=move_2.Geometry, Radius=panel_3, UCount=10, VCount=20)
preview_3 = CustomPreview(Geometry=msphere_2, Material=colour_rgb_3)
